# Dynamo graph 1. TYPES_ACTIVE VIEW.dyn (Dynamo 2.16.2.5624)

python_script = Python()  # IronPython2; unwired: IN[0]
# ---------- python_script.python (85 lines) ----------
import clr
import sys
import System
from System import Array
from System.Collections.Generic import *

clr.AddReference('ProtoGeometry')
from Autodesk.DesignScript.Geometry import *

clr.AddReference('RevitNodes')
import Revit
clr.ImportExtensions(Revit.Elements)
clr.ImportExtensions(Revit.GeometryConversion)

clr.AddReference('RevitServices')
import RevitServices
from RevitServices.Persistence import DocumentManager
from RevitServices.Transactions import TransactionManager

clr.AddReference('RevitAPI')
clr.AddReference('RevitAPIUI')
import Autodesk
from Autodesk.Revit.DB import *
from Autodesk.Revit.UI import *
from Autodesk.Revit.UI.Selection import *

# References
doc = DocumentManager.Instance.CurrentDBDocument
uiapp = DocumentManager.Instance.CurrentUIApplication
uidoc = uiapp.ActiveUIDocument

# Function to get parameter value
def get_parameter(param):
    """Get value from a parameter based on its Storage Type"""
    if param:
        if param.StorageType == StorageType.Double:
            return param.AsDouble()
        elif param.StorageType == StorageType.ElementId:
            return param.AsElementId()
        elif param.StorageType == StorageType.Integer:
            return param.AsInteger()
        elif param.StorageType == StorageType.String:
            return param.AsString()
    return None

# Get the active view
active_view = uidoc.ActiveView

# Collector
collector = FilteredElementCollector(doc, active_view.Id)
visible_elements = collector.WhereElementIsNotElementType().ToElements()

# Inputs
element_types = []  # Lista de tipos
type_ids = []  # Cambiado de conjunto a lista
type_categories = []  # Categorías relacionadas con los tipos
type_names = []  # Nombres de los tipos relacionados con los IDs
family_names=[]

## CODE ##

for element in visible_elements:
    type_id = element.GetTypeId()
    if type_id and not type_id.Equals(ElementId.InvalidElementId):
        if type_id not in type_ids:  # Verificar si el ID ya fue agregado
            type_ids.append(type_id)  # Agregar el ID a la lista
            element_type = doc.GetElement(type_id)
            type_name = get_parameter(element_type.get_Parameter(BuiltInParameter.SYMBOL_NAME_PARAM))
            
            category = element.Category
            category_name = category.Name if category else "No Category"
            
            family_Name = get_parameter(element_type.get_Parameter(BuiltInParameter.ALL_MODEL_FAMILY_NAME))
            
            # Agregar los valores relacionados
            family_names.append(family_Name)
            type_names.append(type_name)
            type_categories.append(category_name)
            element_types.append(element_type)

# Crear la lista final con las relaciones correctas
lista = [family_names, type_names, type_categories, type_ids]

# Output
OUT = lista
# ----------------------------------------
file_path = Filename("PANDAS\EXCEL_V1.xlsx")
python_script_2 = Python(IN[0]=python_script, IN[1]=file_path)  # CPython3
# ---------- python_script_2.python (20 lines) ----------
import pandas as pd

lista = IN[0]
ubicacion = IN[1]
columna_vacia = [""]*len(lista[0])

df_rss = pd.DataFrame({
    "Family_Name": lista[0],
    "Type_Name": lista[1],  
    "Category": lista[2],
    "Assembly Code": columna_vacia,     
    "IDs": lista[3]})

if ubicacion:
	df_rss.to_excel(ubicacion, index = False)
	a = "Calculo realizado"
else:
	a = "Coloca la entrada para iniciar"

OUT =  a
# ----------------------------------------
