# Dynamo graph 2. TO ASSEMBLY CODE .dyn "2. TO ASSEMBLY CODE" (Dynamo 2.16.2.5624)

file_path = Filename("C:\Users\oscar\OneDrive\Documentos\EXCEL_V1.xlsx")
python_script = Python(IN[0]=file_path)  # CPython3
# ---------- python_script.python (11 lines) ----------
import pandas as pd
ubicacion = IN[0]

if str(ubicacion) != "": 
    datos = pd.read_excel(ubicacion)
    dict = datos.to_dict(orient = "list")
    a = "Calculo realizado"
else:
    a = "No realizado el calculo. Inserta ubicacio"
    
OUT =  [dict["IDs"], dict["Assembly Code"]]
# ----------------------------------------
python_script_2 = Python(IN[0]=python_script)  # IronPython2
# ---------- python_script_2.python (43 lines) ----------
import clr
import sys
import System
from System import Array
from System.Collections.Generic import *

clr.AddReference('ProtoGeometry')
from Autodesk.DesignScript.Geometry import *

clr.AddReference('RevitNodes')
import Revit
clr.ImportExtensions(Revit.Elements)
clr.ImportExtensions(Revit.GeometryConversion)

clr.AddReference('RevitServices')
import RevitServices
from RevitServices.Persistence import DocumentManager
from RevitServices.Transactions import TransactionManager

clr.AddReference('RevitAPI')
clr.AddReference('RevitAPIUI')
import Autodesk
from Autodesk.Revit.DB import *
from Autodesk.Revit.UI import *
from Autodesk.Revit.UI.Selection import *

#References
doc   = DocumentManager.Instance.CurrentDBDocument
uiapp = DocumentManager.Instance.CurrentUIApplication
app   = uiapp.Application
uidoc = uiapp.ActiveUIDocument
selection = uidoc.Selection
rvt_year    = int(app.VersionNumber)
__title__ = "Walls"

ID = IN[0][0]

if ID:
	elements = [doc.GetElement(ElementId(x)) for x in ID]
else: 
	elements = "Calculo no realizado, revisa tus entradas"

OUT = elements
# ----------------------------------------
code_block = CodeBlock { "Assembly Code"; }
code_block_2 = CodeBlock(A=python_script) { A[1]; }
string_from_object = FromObject(object=code_block_2)
setParameterByName = Element.SetParameterByName(element=python_script_2, parameterName=code_block, value=string_from_object)
