# Dynamo graph 3. EXPORT_SCHEDULES V2.dyn "3. EXPORT_SCHEDULES" (Dynamo 2.16.2.5624)

boolean = BoolSelector(false)
boolean_2 = BoolSelector(true)
INTERFAZ = Python(IN[0]=boolean_2)  # IronPython2
# ---------- INTERFAZ.python (285 lines) ----------
import clr
import sys
import System
from System import Array
from System.Collections.Generic import *

clr.AddReference('ProtoGeometry')
from Autodesk.DesignScript.Geometry import *

clr.AddReference('RevitNodes')
import Revit
clr.ImportExtensions(Revit.Elements)
clr.ImportExtensions(Revit.GeometryConversion)

clr.AddReference('RevitServices')
import RevitServices
from RevitServices.Persistence import DocumentManager
from RevitServices.Transactions import TransactionManager

clr.AddReference('RevitAPI')
clr.AddReference('RevitAPIUI')
import Autodesk
from Autodesk.Revit.DB import *
from Autodesk.Revit.UI import *
from Autodesk.Revit.UI.Selection import *
clr.AddReference('System')
clr.AddReference("System.Windows.Forms")
clr.AddReference("System.Drawing")

#Import system
import System
from System.Windows.Forms import *
from System.Drawing import  Point, Size, Font, FontStyle, Drawing2D

class OM_Form(Form):                  # Heredas todo de la clase forms 
    def __init__(self):
        self.Text = 'OMBIM WinForm'
        self.Size = Size(500,800)
        self.StartPosition = FormStartPosition.CenterScreen
        self.FormBorderStyle = FormBorderStyle.FixedDialog
        self.TopMost = True  # Tu ventana antes de las demás
        self.ShowIcon = False  # Quita el icono de la barra de título
        self.MaximizeBox = False  # Quita el botón de maximizar
        self.MinimizeBox = False  # Quita el botón de minimizar
        self.submitted = False  
       # Label for Textbox 
        self.label_textbox = Label()
        self.label_textbox.Text = "Export Schedules"
        self.label_textbox.Location = Point(20, 20)
        self.label_textbox.Size = Size(180, 80)
        self.Controls.Add(self.label_textbox)
        self.label_textbox.Font = Font("Arial", 20, FontStyle.Bold)
        self.label_textbox.ForeColor = System.Drawing.Color.Blue

        # Label for ListBox
        self.labelListBox = Label()
        self.labelListBox.Text = "1. Schedule List"
        self.labelListBox.Location = Point(20,110)
        self.labelListBox.Size = Size(200,40)
        self.labelListBox.Font = Font("Arial", 12, FontStyle.Bold)
        self.Controls.Add(self.labelListBox)
        
        # Evento para capturar cierre por "X"
        self.FormClosing += self.on_form_closing

        # Label for list box Filter
        self.labelFilter = Label()
        self.labelFilter.Text = "Filter"
        self.labelFilter.Location = Point(20,150)
        self.labelFilter.Size = Size(80,20)
        self.Controls.Add(self.labelFilter)

        # TextBox for ListBOx Filter
        self.textBoxFilter = TextBox()
        self.textBoxFilter.Location = Point(100, 150)
        self.textBoxFilter.Size  = Size(350,20)
        self.Controls.Add(self.textBoxFilter)
        self.textBoxFilter.TextChanged += self.filter_updated

        # CheckedListBox
        self.checkedListBox = CheckedListBox()
        self.checkedListBox.Location = Point(20, 180)  # Se desplaza un poco hacia abajo
        self.checkedListBox.Size = Size(430, 300)
        self.Controls.Add(self.checkedListBox)
        self.update_listBox()

        # Button to select all filtered items
        self.buttonSelectAll = Button()
        self.buttonSelectAll.Text = "Select All"
        self.buttonSelectAll.Location = Point(20,490)  # Ajusta la posición según tu diseño
        self.buttonSelectAll.Size = Size(100, 30)
        self.buttonSelectAll.Click += self.select_all_items
        self.Controls.Add(self.buttonSelectAll)

        # Button to deselect all filtered items
        self.buttonDeselectAll = Button()
        self.buttonDeselectAll.Text = "Deselect All"
        self.buttonDeselectAll.Location = Point(130, 490)  # Ajusta la posición según tu diseño
        self.buttonDeselectAll.Size = Size(100, 30)
        self.buttonDeselectAll.Click += self.deselect_all_items
        self.Controls.Add(self.buttonDeselectAll)

        #Create a separator
        self.separator1 = Panel()
        self.separator1.Height = 2 
        self.separator1.Width = 450
        self.separator1.BackColor = System.Drawing.Color.Black
        self.separator1.Location = Point(10,530)
        self.Controls.Add(self.separator1)

        # Label for ListBox
        self.labelListBox2 = Label()
        self.labelListBox2.Text = "2. Excel File"
        self.labelListBox2.Location = Point(20,550)
        self.labelListBox2.Size = Size(200,30)
        self.labelListBox2.Font = Font("Arial", 12, FontStyle.Bold)
        self.Controls.Add(self.labelListBox2)
        
        # TextBox
        self.textBox = TextBox()
        self.textBox.Text = ""
        self.textBox.Location = Point(150, 600)
        self.textBox.Size = Size(320, 50)
        self.Controls.Add(self.textBox)

        # Button to open File Dialog
        self.buttonFile = Button()
        self.buttonFile.Text = "Select File"
        self.buttonFile.Location = Point(20, 600)
        self.buttonFile.Size = Size(100, 30)
        self.Controls.Add(self.buttonFile)
        
        # Register event for File Button
        self.buttonFile.Click += self.on_select_file_click
        

        # Submit Button
        self.submit_button = Button()
        self.submit_button.Text = "Submit"
        self.submit_button.Location = Point(170,650)
        self.submit_button.Size = Size(150,40)
        self.submit_button.Click += self.Submit_Button
        self.Controls.Add(self.submit_button)


        # Label with 
        self.label_footer = Label()
        self.label_footer.Text = "Developed by: Oscar Mendoza"
        self.label_footer.Location = Point(20, 710)
        self.label_footer.Size = Size(300, 30)
        self.label_footer.Font = Font("Arial", 7)
        self.label_footer.ForeColor = System.Drawing.Color.Blue
        self.Controls.Add(self.label_footer)

        # hyperlink
        self.linkLabel1 = LinkLabel()
        self.linkLabel1.Text = "Yt: OMBIM "
        self.linkLabel1.Location = Point(320, 710)
        self.linkLabel1.Size = Size(100, 30)
        self.linkLabel1.LinkClicked += self.link1_clicked
        self.Controls.Add(self.linkLabel1)

        # Second hyperlink
        self.linkLabel2 = LinkLabel()
        self.linkLabel2.Text = "Linkedin"
        self.linkLabel2.Location = Point(420, 710)
        self.linkLabel2.Size = Size(100, 30)
        self.linkLabel2.LinkClicked += self.link2_clicked
        self.Controls.Add(self.linkLabel2)

    # EVENTS 
        
    def on_select_file_click(self, sender, e):
        # Open File Dialog
        file_dialog = OpenFileDialog()
        file_dialog.Filter = "All files (*.*)|*.*"
        
        if file_dialog.ShowDialog() == DialogResult.OK:
            file_path = file_dialog.FileName
            self.textBox.Text = file_path  # Display the selected file path in the TextBox

    def Submit_Button(self, sender,event):
        global OUT  # Captura mensaje del evento 
        message1 = "Print Submited"
        message2 = self.textBox.Text
        message3 = [self.schedule_mapping[self.checkedListBox.Items[i]] for i in self.checkedListBox.CheckedIndices]

        if self.textBox.Text == "":
            OUT = "CANCELAR"
        else:
            OUT = [message1, message2, message3]
        self.submitted = True 
        self.Close()

    def filter_updated(self, sender, event):
        self.update_listBox()

    def update_listBox(self):
        # Obtener la lista de schedules
        schedule_list = FilteredElementCollector(doc).OfCategory(BuiltInCategory.OST_Schedules).\
            WhereElementIsNotElementType().ToElements()
        
        filter_text = self.textBoxFilter.Text.lower()
        self.checkedListBox.Items.Clear()

        # Crear un diccionario para mapear nombres a objetos
        self.schedule_mapping = {schedule.Name: schedule for schedule in schedule_list}

        # Mostrar los nombres filtrados en el CheckedListBox
        for name, schedule in self.schedule_mapping.items():
            if filter_text in name.lower():
                self.checkedListBox.Items.Add(name)
    # EVENT: Select all items
    def select_all_items(self, sender, event):
        for i in range(self.checkedListBox.Items.Count):
            self.checkedListBox.SetItemChecked(i, True)

    # EVENT: Deselect all items
    def deselect_all_items(self, sender, event):
        for i in range(self.checkedListBox.Items.Count):
            self.checkedListBox.SetItemChecked(i, False)

    # Event handler for first hyperlink
    def link1_clicked(self, sender, e):
        System.Diagnostics.Process.Start("https://www.youtube.com/@mendozaballenabim")

    # Event handler for second hyperlink
    def link2_clicked(self, sender, e):
        System.Diagnostics.Process.Start("https://www.linkedin.com/in/omendozab/")
        
    def on_form_closing(self, sender, e):
        """Captura el cierre del formulario por el botón de la 'X'."""
        global OUT
        if not self.submitted:  # Si no se presionó Submit, significa que cerraron con la "X"
            OUT = "CANCELAR"

#References
doc   = DocumentManager.Instance.CurrentDBDocument
uiapp = DocumentManager.Instance.CurrentUIApplication
app   = uiapp.Application
uidoc = uiapp.ActiveUIDocument
selection = uidoc.Selection
rvt_year    = int(app.VersionNumber)
__title__ = "Walls"



result = []
schedules_names = []
run = IN[0]

if run:    
    # Show the form
    form = OM_Form()
    Application.Run(form)  # el codigo para hasta que le demos instrucciones
    if OUT == "CANCELAR":
        OUT = "Operacion cancelada por usuario"
    else:
        ubicacion = OUT[1]
        schedules = OUT[2]
        for i in range(len(schedules)):
            schedule = UnwrapElement(schedules[i])
            name = schedule.Name
            schedules_names.append(name)
            # Transaction 
            TransactionManager.Instance.EnsureInTransaction(doc)

            table = schedule.GetTableData().GetSectionData(SectionType.Body)
            nRows = table.NumberOfRows
            nColumns = table.NumberOfColumns

            # Collect all of data from the schedule
            dataListRow = []
            for row in range(nRows):
                dataListColumn = []
                for column in range(nColumns): 
                    dataListColumn.append(TableView.GetCellText(schedule, SectionType.Body, row, column))
                dataListRow.append(dataListColumn)

            # Transaction
            TransactionManager.Instance.TransactionTaskDone()
            result.append(dataListRow)
        OUT = result, schedules_names, ubicacion
else: 
    OUT = "True para ejecutar"
# ----------------------------------------
PROCESAMIENTO = Python(IN[0]=boolean, IN[1]=INTERFAZ)  # CPython3
# ---------- PROCESAMIENTO.python (20 lines) ----------
import pandas as pd


entrada = IN[0]
ubicacion = IN[1][2]
macro_lista = IN[1][0]
nombres_hojas = IN[1][1]

listas_dict = {nombres_hojas[i]: macro_lista[i] for i in range(len(macro_lista))}

if entrada: 
    with pd.ExcelWriter(ubicacion, engine='openpyxl') as writer:
        for nombre, lista in listas_dict.items():
            df = pd.DataFrame(lista)
            df.to_excel(writer, sheet_name=nombre, index=False, header = False)
    a = "Calculo realizado"
else:
    a = "Coloca true para ejecutar"

OUT = a
# ----------------------------------------
