# Dynamo graph Data_Sheets_v3.dyn (Dynamo 2.19.3.6394)
# author: Oscar Mendoza Ballena - OMBIM
# Script para poder parametrizar los planos de los modelos de manera masiva - Columnas en excel [0]Number , [1] Name [2...n] Parametros

categories = Categories("OST_Sheets")
all_elements_of_category = ElementsOfCategory(Category=categories)
code_block = CodeBlock(A=all_elements_of_category) { A.Name; }
code_block_2 = CodeBlock { "Número de plano"; }
getParameterValueByName = Element.GetParameterValueByName(element=all_elements_of_category, parameterName=code_block_2)
code_block_3 = CodeBlock(A=code_block, B=getParameterValueByName) { A+"_"+B; }
byKeysValues = DesignScript.Builtin.Dictionary.ByKeysValues(keys=code_block_3, values=all_elements_of_category)
excel_entrada = Filename("C:\Users\User\Desktop\AAAv2.xlsx")  # graph input
file_from_path = FileObject(path=excel_entrada)
# note: Script creado por:
code_block_4 = CodeBlock { "Hoja1"; }
importExcel = Data.ImportExcel(file=file_from_path, sheetName=code_block_4)
code_block_5 = CodeBlock { 0; }
removeItemAtIndex = List.RemoveItemAtIndex(list=importExcel, indices=code_block_5)
transpose = List.Transpose(lists=removeItemAtIndex)
code_block_6 = CodeBlock(A=transpose) { A[1]; }
code_block_7 = CodeBlock(A=transpose) { A[0]; }
code_block_8 = CodeBlock(A=code_block_6, B=code_block_7) { A+"_"+B; }
valueAtKey = DesignScript.Builtin.Dictionary.ValueAtKey(dictionary=byKeysValues, key=code_block_8)
code_block_9 = CodeBlock { [0,1]; }
removeItemAtIndex_2 = List.RemoveItemAtIndex(list=transpose, indices=code_block_9)
count = List.Count(list=removeItemAtIndex_2)
ofRepeatedItem = List.OfRepeatedItem(item=valueAtKey, amount=count)
code_block_10 = CodeBlock(A=importExcel) { A[0]; }
code_block_11 = CodeBlock { [0,1]; }
removeItemAtIndex_3 = List.RemoveItemAtIndex(list=code_block_10, indices=code_block_11)
setParameterByName = Element.SetParameterByName(element=ofRepeatedItem, parameterName=removeItemAtIndex_3, value=removeItemAtIndex_2)
